# Dynamo graph Donusumler.dyn (Dynamo 3.4.1.7055)

select_model_elements = DSModelElementsSelection()  # 7 picked in the model
curve = DetailCurve.Curve(detailCurve=select_model_elements)
byJoinedCurves = PolyCurve.ByJoinedCurves(curves=curve)
points = PolyCurve.Points(polyCurve=byJoinedCurves)
byPoints = Polygon.ByPoints(points=points)
byPatch = Surface.ByPatch(closedCurve=byJoinedCurves)
list_create = List.Create(item0=curve, item1=byJoinedCurves, item2=byPoints, item3=byPatch, item4=points)
watch = Watch(list_create)
dynamo_shapely = Custom[Dynamo → Shapely](DynGeometry=watch)  # Converts Dynamo geometry to Shapely geometry.
watch_2 = Watch(dynamo_shapely)
shapely_dynamo = Custom[Shapely → Dynamo](ShpGeometry=watch_2)  # Converts Shapely geometry to Dynamo geometry.
color_palette = ColorPalette({R: 255, G: 0, B: 0, A: 255})
byGeometryColor = Modifiers.GeometryColor.ByGeometryColor(geometry=shapely_dynamo, color=color_palette)
watch_3 = Watch(shapely_dynamo)
shapely_numpy = Custom[Shapely → Numpy](ShpGeometry=watch_2)  # Converts Shapely geometry to Numpy standards.
watch_4 = Watch(shapely_numpy)
numpy_shapely = Custom[Numpy → Shapely](Numpy=watch_4)  # Converts Numpy standards to Shapely geometry.
watch_5 = Watch(numpy_shapely)
shapely_dynamo_2 = Custom[Shapely → Dynamo](ShpGeometry=watch_5)
watch_6 = Watch(shapely_dynamo_2)
