# Dynamo graph Shp_Buffer.dyn (Dynamo 3.4.1.7055)

code_block = CodeBlock()
# ---------- code_block.designscript (6 lines) ----------
//Round
1;
//Mitre
2;
//Bevel
3;
# ----------------------------------------
code_block_2 = CodeBlock { 0.5; }
select_model_elements = DSModelElementsSelection()  # 8 picked in the model
curve = DetailCurve.Curve(detailCurve=select_model_elements)
byJoinedCurves = PolyCurve.ByJoinedCurves(curves=curve)
byPatch = Surface.ByPatch(closedCurve=byJoinedCurves)
dynamo_shapely = Custom[Dynamo → Shapely](DynGeometry=byPatch)  # Converts Dynamo geometry to Shapely geometry.
shp_Buffer = Custom[Shp_Buffer](style=code_block.out1, Offset=code_block_2, ShpGeometry=dynamo_shapely)  # A shapely buffer creates a new geometry extended by a specified distance around a geometry (point, line or polygon). This operation adds a buffer zone around the geometry based on the given distance.
shapely_dynamo = Custom[Shapely → Dynamo](ShpGeometry=shp_Buffer)  # Converts Shapely geometry to Dynamo geometry.
watch = Watch(shapely_dynamo)
color_palette = ColorPalette({R: 255, G: 0, B: 0, A: 255})
byGeometryColor = Modifiers.GeometryColor.ByGeometryColor(geometry=watch, color=color_palette)
watch_2 = Watch(byPatch)
watch_3 = Watch(shp_Buffer)
