# Dynamo graph Shp_Contains.dyn (Dynamo 3.4.1.7055)

code_block = CodeBlock { x = 10; x/2; }
byWidthLength = Rectangle.ByWidthLength(width=code_block.x, length=code_block.x)
byPatch = Surface.ByPatch(closedCurve=byWidthLength)
translate = Geometry.Translate(geometry=byPatch, xTranslation=code_block.out1, yTranslation=code_block.out1)
dynamo_shapely = Custom[Dynamo → Shapely](DynGeometry=translate)  # Converts Dynamo geometry to Shapely geometry.
code_block_2 = CodeBlock { 1; }
shp_Segmentize = Custom[Shp_Segmentize](ShpGeometry=dynamo_shapely, NSegment=code_block_2)  # It divides a geometry into smaller segments. This process breaks down the geometry into smaller pieces for more precise analysis and calculations.
shapely_dynamo = Custom[Shapely → Dynamo](ShpGeometry=shp_Segmentize)  # Converts Shapely geometry to Dynamo geometry.
dynamo_shapely_2 = Custom[Dynamo → Shapely](DynGeometry=byPatch)
shp_Contains = Custom[Shp_Contains](ShpPolygon=dynamo_shapely_2, ShpGeometry=shp_Segmentize)  # It checks whether one geometry completely encompasses the other. In other words, it checks whether the first geometry contains the second geometry.
groupByKey = List.GroupByKey(list=shapely_dynamo, keys=shp_Contains)
deconstruct = List.Deconstruct(list=groupByKey.groups)
color_palette = ColorPalette({R: 255, G: 0, B: 0, A: 255})
byGeometryColor = Modifiers.GeometryColor.ByGeometryColor(geometry=deconstruct.rest, color=color_palette)
color_palette_2 = ColorPalette({R: 0, G: 21, B: 76, A: 255})
byGeometryColor_2 = Modifiers.GeometryColor.ByGeometryColor(geometry=deconstruct.first, color=color_palette_2)
watch = Watch(shp_Contains)
watch_2 = Watch(shp_Segmentize)
