# Dynamo graph Shp_ConvexHull.dyn (Dynamo 3.4.1.7055)

select_model_elements = DSModelElementsSelection()  # 8 picked in the model
curve = DetailCurve.Curve(detailCurve=select_model_elements)
byJoinedCurves = PolyCurve.ByJoinedCurves(curves=curve)
byPatch = Surface.ByPatch(closedCurve=byJoinedCurves)
dynamo_shapely = Custom[Dynamo → Shapely](DynGeometry=byPatch)  # Converts Dynamo geometry to Shapely geometry.
shp_ConvexHull = Custom[Shp_ConvexHull](ShpGeometry=dynamo_shapely)  # It forms the smallest convex polygon that encompasses the entire geometry or set of points. The resulting geometry is a boundary that surrounds all points without containing any concave indentations.
shapely_dynamo = Custom[Shapely → Dynamo](ShpGeometry=shp_ConvexHull)  # Converts Shapely geometry to Dynamo geometry.
watch = Watch(shapely_dynamo)
color_palette = ColorPalette({R: 255, G: 0, B: 0, A: 255})
byGeometryColor = Modifiers.GeometryColor.ByGeometryColor(geometry=watch, color=color_palette)
watch_2 = Watch(byPatch)
watch_3 = Watch(shp_ConvexHull)
