# Dynamo graph Shp_GeoJSON.dyn (Dynamo 3.4.1.7055)

file_path = Filename("..\..\Downloads\export.geojson")
geojson_shapely = Custom[GeoJSON → Shapely](FilePath=file_path)  # Converts GeoJSON standard data to Shapely geometry.
shapely_dynamo = Custom[Shapely → Dynamo](ShpGeometry=geojson_shapely.ShpGeometry)  # Converts Shapely geometry to Dynamo geometry.
