# Dynamo graph Shp_NearestPoint.dyn (Dynamo 3.4.1.7055)

select_model_elements = DSModelElementsSelection()  # 7 picked in the model
curve = DetailCurve.Curve(detailCurve=select_model_elements)
byJoinedCurves = PolyCurve.ByJoinedCurves(curves=curve)
byPatch = Surface.ByPatch(closedCurve=byJoinedCurves)
dynamo_shapely = Custom[Dynamo → Shapely](DynGeometry=byPatch)  # Converts Dynamo geometry to Shapely geometry.
points = PolyCurve.Points(polyCurve=byJoinedCurves)
byPoints = Polygon.ByPoints(points=points)
center = Polygon.Center(polygon=byPoints)
code_block = CodeBlock { 7; }
byCenterPointRadius = Circle.ByCenterPointRadius(centerPoint=center, radius=code_block)
code_block_2 = CodeBlock { 0..1..#10; }
pointAtParameter = Curve.PointAtParameter(curve=byCenterPointRadius, param=code_block_2)
code_block_3 = CodeBlock(x=pointAtParameter) { a = DSCore.List.Count(x)-1; b = DSCore.List.Shuffle(1..2.5..#a); c = Circle.ByCenterPointRadius(x,b); }
code_block_4 = CodeBlock { 0..1..#100; }
pointAtParameter_2 = Curve.PointAtParameter(curve=code_block_3.c, param=code_block_4@L2, lacing=Longest)
byPoints_2 = Polygon.ByPoints(points=pointAtParameter_2)
dynamo_shapely_2 = Custom[Dynamo → Shapely](DynGeometry=byPoints_2)
shp_NearestPoint = Custom[Shp_NearestPoint](ShpGeometry=dynamo_shapely, ShpGeometry_2=dynamo_shapely_2)  # rotates the other geometry closest to a given geometry. This operation is used to find the shortest distance between two geometries.
shapely_dynamo = Custom[Shapely → Dynamo](ShpGeometry=shp_NearestPoint)  # Converts Shapely geometry to Dynamo geometry.
watch = Watch(shapely_dynamo)
color_palette = ColorPalette({R: 255, G: 0, B: 0, A: 255})
byGeometryColor = Modifiers.GeometryColor.ByGeometryColor(geometry=watch, color=color_palette)
watch_2 = Watch(byPatch)
watch_3 = Watch(byPoints_2)
watch_4 = Watch(shp_NearestPoint)
