# Dynamo graph Shp_Offset.dyn (Dynamo 3.4.1.7055)

select_model_elements = DSModelElementsSelection()  # 7 picked in the model
curve = DetailCurve.Curve(detailCurve=select_model_elements)
byJoinedCurves = PolyCurve.ByJoinedCurves(curves=curve)
byPatch = Surface.ByPatch(closedCurve=byJoinedCurves)
dynamo_shapely = Custom[Dynamo → Shapely](DynGeometry=byPatch)  # Converts Dynamo geometry to Shapely geometry.
code_block = CodeBlock { 1; }
shp_Offset = Custom[Shp_Offset](ShpGeometry=dynamo_shapely, Offset=code_block)  # Creates a new geometry by shifting the boundaries of a geometry by the specified distance. This operation is used to shift the boundaries of polygons inwards or outwards.
shapely_dynamo = Custom[Shapely → Dynamo](ShpGeometry=shp_Offset)  # Converts Shapely geometry to Dynamo geometry.
watch = Watch(shapely_dynamo)
color_palette = ColorPalette({R: 255, G: 0, B: 0, A: 255})
byGeometryColor = Modifiers.GeometryColor.ByGeometryColor(geometry=watch, color=color_palette)
watch_2 = Watch(shp_Offset)
