# Dynamo graph Shp_PerimeterInterior.dyn (Dynamo 3.4.1.7055)

code_block = CodeBlock { x = 10; x/2; }
byWidthLength = Rectangle.ByWidthLength(width=code_block.x, length=code_block.x)
byPatch = Surface.ByPatch(closedCurve=byWidthLength)
dynamo_shapely = Custom[Dynamo → Shapely](DynGeometry=byPatch)  # Converts Dynamo geometry to Shapely geometry.
byWidthLength_2 = Rectangle.ByWidthLength(width=code_block.out1, length=code_block.out1)
byPatch_2 = Surface.ByPatch(closedCurve=byWidthLength_2)
dynamo_shapely_2 = Custom[Dynamo → Shapely](DynGeometry=byPatch_2)
shp_Difference = Custom[Shp_Difference](ShpGeometry=dynamo_shapely, ShpGeometry_2=dynamo_shapely_2)  # It calculates the difference between two geometries. It subtracts the area where the second geometry intersects from the first geometry. This operation is used to see the difference between one geometry and other geometries.
shp_PerimeterInterior = Custom[Shp_PerimeterInterior](ShpGeometry=shp_Difference)  # Calculates the inner boundaries (holes) and outer boundaries of a polygon. Inner boundaries are the voids within the polygon.
shapely_dynamo = Custom[Shapely → Dynamo](ShpGeometry=shp_PerimeterInterior)  # Converts Shapely geometry to Dynamo geometry.
watch = Watch(shapely_dynamo)
color_palette = ColorPalette({R: 255, G: 0, B: 0, A: 255})
byGeometryColor = Modifiers.GeometryColor.ByGeometryColor(geometry=watch, color=color_palette)
watch_2 = Watch(byPatch)
watch_3 = Watch(shp_PerimeterInterior)
watch_4 = Watch(shp_Difference)
