# Dynamo graph Shp_Polygonise.dyn (Dynamo 3.4.1.7055)

select_model_elements = DSModelElementsSelection()  # 8 picked in the model
curve = DetailCurve.Curve(detailCurve=select_model_elements)
byJoinedCurves = PolyCurve.ByJoinedCurves(curves=curve)
byPatch = Surface.ByPatch(closedCurve=byJoinedCurves)
dynamo_shapely = Custom[Dynamo → Shapely](DynGeometry=byPatch)  # Converts Dynamo geometry to Shapely geometry.
code_block = CodeBlock { 10; }
shp_Polgonise = Custom[Shp_Polgonise](Shp_Geometry=dynamo_shapely, Ncount=code_block)  # It finds the boundaries of the geometry and divides it into the number of geometries specified by the user. Each divided piece is given as a “closed polygon”.
shapely_dynamo = Custom[Shapely → Dynamo](ShpGeometry=shp_Polgonise)  # Converts Shapely geometry to Dynamo geometry.
watch = Watch(shapely_dynamo)
color_palette = ColorPalette({R: 255, G: 0, B: 0, A: 255})
byGeometryColor = Modifiers.GeometryColor.ByGeometryColor(geometry=watch, color=color_palette)
watch_2 = Watch(byPatch)
watch_3 = Watch(shp_Polgonise)
