# Dynamo graph Shp_Rotate.dyn (Dynamo 3.4.1.7055)

code_block = CodeBlock { 15; }
select_model_elements = DSModelElementsSelection()  # 7 picked in the model
curve = DetailCurve.Curve(detailCurve=select_model_elements)
byJoinedCurves = PolyCurve.ByJoinedCurves(curves=curve)
byPatch = Surface.ByPatch(closedCurve=byJoinedCurves)
dynamo_shapely = Custom[Dynamo → Shapely](DynGeometry=byPatch)  # Converts Dynamo geometry to Shapely geometry.
shp_Rotate = Custom[Shp_Rotate](Angle=code_block, ShpGeometry=dynamo_shapely)  # Rotates a geometry by the specified angle.
shapely_dynamo = Custom[Shapely → Dynamo](ShpGeometry=shp_Rotate)  # Converts Shapely geometry to Dynamo geometry.
watch = Watch(shapely_dynamo)
color_palette = ColorPalette({R: 255, G: 0, B: 0, A: 255})
byGeometryColor = Modifiers.GeometryColor.ByGeometryColor(geometry=watch, color=color_palette)
watch_2 = Watch(shp_Rotate)
