# Dynamo graph Shp_RotateSkew.dyn (Dynamo 3.4.1.7055)

code_block = CodeBlock()
# ---------- code_block.designscript (4 lines) ----------
//X :
15;
//Y :
0;
# ----------------------------------------
select_model_elements = DSModelElementsSelection()  # 7 picked in the model
curve = DetailCurve.Curve(detailCurve=select_model_elements)
byJoinedCurves = PolyCurve.ByJoinedCurves(curves=curve)
byPatch = Surface.ByPatch(closedCurve=byJoinedCurves)
dynamo_shapely = Custom[Dynamo → Shapely](DynGeometry=byPatch)  # Converts Dynamo geometry to Shapely geometry.
shp_RotateSkew = Custom[Shp_RotateSkew](Y=code_block.out1, X=code_block.out0, ShpGeometry=dynamo_shapely)  # rotates a geometry and simultaneously applies skew to it. This operation changes the position of the geometry while also providing a more complex transformation.
shapely_dynamo = Custom[Shapely → Dynamo](ShpGeometry=shp_RotateSkew)  # Converts Shapely geometry to Dynamo geometry.
watch = Watch(shapely_dynamo)
color_palette = ColorPalette({R: 255, G: 0, B: 0, A: 255})
byGeometryColor = Modifiers.GeometryColor.ByGeometryColor(geometry=watch, color=color_palette)
watch_2 = Watch(shp_RotateSkew)
