# Dynamo graph Shp_Scale.dyn (Dynamo 3.4.1.7055)

code_block = CodeBlock()
# ---------- code_block.designscript (4 lines) ----------
//X :
1.5;
//Y :
1.5;
# ----------------------------------------
select_model_elements = DSModelElementsSelection()  # 7 picked in the model
curve = DetailCurve.Curve(detailCurve=select_model_elements)
byJoinedCurves = PolyCurve.ByJoinedCurves(curves=curve)
byPatch = Surface.ByPatch(closedCurve=byJoinedCurves)
dynamo_shapely = Custom[Dynamo → Shapely](DynGeometry=byPatch)  # Converts Dynamo geometry to Shapely geometry.
shp_Scale = Custom[Shp_Scale](X=code_block.out0, Y=code_block.out1, ShpGeometry=dynamo_shapely)  # Scales a geometry by a specific factor. It expands or contracts the geometry along both the horizontal and vertical axes.
shapely_dynamo = Custom[Shapely → Dynamo](ShpGeometry=shp_Scale)  # Converts Shapely geometry to Dynamo geometry.
watch = Watch(shapely_dynamo)
color_palette = ColorPalette({R: 255, G: 0, B: 0, A: 255})
byGeometryColor = Modifiers.GeometryColor.ByGeometryColor(geometry=watch, color=color_palette)
watch_2 = Watch(shp_Scale)
