# Dynamo graph Shp_SharedPath.dyn (Dynamo 3.4.1.7055)

code_block = CodeBlock { x = 10; 5; }
byWidthLength = Rectangle.ByWidthLength(width=code_block.x, length=code_block.x)
byPatch = Surface.ByPatch(closedCurve=byWidthLength)
dynamo_shapely = Custom[Dynamo → Shapely](DynGeometry=byPatch)  # Converts Dynamo geometry to Shapely geometry.
translate = Geometry.Translate(geometry=byWidthLength, yTranslation=code_block.out1)
byPatch_2 = Surface.ByPatch(closedCurve=translate)
dynamo_shapely_2 = Custom[Dynamo → Shapely](DynGeometry=byPatch_2)
shp_SharedPaths = Custom[Shp_SharedPaths](ShpGeometry=dynamo_shapely, ShpGeometry_2=dynamo_shapely_2)  # Determines the common paths (or intersections of paths) between two geometries. This operation is used to find common edges or connections.
shapely_dynamo = Custom[Shapely → Dynamo](ShpGeometry=shp_SharedPaths)  # Converts Shapely geometry to Dynamo geometry.
color_palette = ColorPalette({R: 255, G: 0, B: 0, A: 255})
byGeometryColor = Modifiers.GeometryColor.ByGeometryColor(geometry=shapely_dynamo, color=color_palette)
watch = Watch(shp_SharedPaths)
watch_2 = Watch(shapely_dynamo)
