# Dynamo graph Shp_SkeletonPruning-v2.dyn (Dynamo 3.4.1.7055)

select_model_elements = DSModelElementsSelection()  # 6 picked in the model
curve = DetailCurve.Curve(detailCurve=select_model_elements)
select_model_elements_2 = DSModelElementsSelection()  # 4 picked in the model
curve_2 = DetailCurve.Curve(detailCurve=select_model_elements_2)
select_model_elements_3 = DSModelElementsSelection()  # 4 picked in the model
curve_3 = DetailCurve.Curve(detailCurve=select_model_elements_3)
select_model_elements_4 = DSModelElementsSelection()  # 4 picked in the model
curve_4 = DetailCurve.Curve(detailCurve=select_model_elements_4)
select_model_elements_5 = DSModelElementsSelection()  # 4 picked in the model
curve_5 = DetailCurve.Curve(detailCurve=select_model_elements_5)
select_model_elements_6 = DSModelElementsSelection()  # 4 picked in the model
curve_6 = DetailCurve.Curve(detailCurve=select_model_elements_6)
select_model_elements_7 = DSModelElementsSelection()  # 4 picked in the model
curve_7 = DetailCurve.Curve(detailCurve=select_model_elements_7)
select_model_elements_8 = DSModelElementsSelection()  # 4 picked in the model
curve_8 = DetailCurve.Curve(detailCurve=select_model_elements_8)
list_create = List.Create(item0=curve, item1=curve_2, item2=curve_3, item3=curve_4, item4=curve_5, item5=curve_6, item6=curve_7, item7=curve_8)
byJoinedCurves = PolyCurve.ByJoinedCurves(curves=list_create)
byPatch = Surface.ByPatch(closedCurve=byJoinedCurves)
deconstruct = List.Deconstruct(list=byPatch)
dynamo_shapely = Custom[Dynamo → Shapely](DynGeometry=deconstruct.first)  # Converts Dynamo geometry to Shapely geometry.
dynamo_shapely_2 = Custom[Dynamo → Shapely](DynGeometry=deconstruct.rest)
shp_Difference = Custom[Shp_Difference](ShpGeometry=dynamo_shapely, ShpGeometry_2=dynamo_shapely_2)  # It calculates the difference between two geometries. It subtracts the area where the second geometry intersects from the first geometry. This operation is used to see the difference between one geometry and other geometries.
code_block = CodeBlock { -0.1; }
shp_Offset = Custom[Shp_Offset](ShpGeometry=shp_Difference, Offset=code_block)  # Creates a new geometry by shifting the boundaries of a geometry by the specified distance. This operation is used to shift the boundaries of polygons inwards or outwards.
shapely_dynamo = Custom[Shapely → Dynamo](ShpGeometry=shp_Offset)  # Converts Shapely geometry to Dynamo geometry.
color_palette = ColorPalette({R: 255, G: 0, B: 0, A: 255})
byGeometryColor = Modifiers.GeometryColor.ByGeometryColor(geometry=shapely_dynamo, color=color_palette)
shp_Boundary = Custom[Shp_Boundary](ShpGeometry=shp_Difference)  # It provides the edges that define a geometry. For polygons, this function returns a line representing the boundaries of the geometry.
shapely_dynamo_2 = Custom[Shapely → Dynamo](ShpGeometry=shp_Boundary)
byPatch_2 = Surface.ByPatch(closedCurve=shapely_dynamo)
code_block_2 = CodeBlock { 0.1; }
shp_Segmentize = Custom[Shp_Segmentize](ShpGeometry=shp_Offset, NSegment=code_block_2)  # It divides a geometry into smaller segments. This process breaks down the geometry into smaller pieces for more precise analysis and calculations.
code_block_3 = CodeBlock { 0; }
shp_Voronoi = Custom[Shp_Voronoi](ShpPoint=shp_Segmentize, Density=code_block_3)  # It generates a Voronoi diagram based on the given set of points. Each Voronoi cell represents the area belonging to the nearest point.
shp_Intersection = Custom[Shp_Intersection](ShpGeometry=shp_Offset, ShpGeometry_2=shp_Voronoi)  # Rotates the common area between two geometries. The intersecting areas are taken and a new geometry is created. This process is used to determine the intersection areas.
code_block_4 = CodeBlock { 0.5; }
code_block_5 = CodeBlock { 2; }
shp_SkeletonPruning = Custom[Shp_SkeletonPruning](ShpLine=shp_Intersection, MinLength=code_block_4, MaxIteration=code_block_5)  # It uses the Topological Analysis method to clean the skeleton (centreline) of a polygon. It cleans the dead-end streets, known as ‘spurs’, which arise from Voronoi diagrams and are not connected to the main line.
watch = Watch(shp_SkeletonPruning)
shapely_dynamo_3 = Custom[Shapely → Dynamo](ShpGeometry=watch)
color_palette_2 = ColorPalette({R: 0, G: 67, B: 255, A: 255})
byGeometryColor_2 = Modifiers.GeometryColor.ByGeometryColor(geometry=shapely_dynamo_3, color=color_palette_2)
watch_2 = Watch(shp_Offset)
watch_3 = Watch(dynamo_shapely_2)
watch_4 = Watch(shp_Intersection)
