# Dynamo graph Shp_SkeletonPruning.dyn (Dynamo 3.4.1.7055)

select_model_element = DSModelElementSelection()  # 1 picked in the model
geometry = Element.Geometry(element=select_model_element)
position = ModelText.Position(modelText=select_model_element)
ZAxis = Vector.ZAxis()
byOriginNormal = Plane.ByOriginNormal(origin=position, normal=ZAxis)
intersect = Geometry.Intersect(geometry=geometry, other=byOriginNormal)
dynamo_shapely = Custom[Dynamo → Shapely](DynGeometry=intersect)  # Converts Dynamo geometry to Shapely geometry.
shp_BuildBoundary = Custom[Shp_BuildBoundary](ShpGeometry=dynamo_shapely)  # Creates a geometry that defines the area surrounding it. This process is used to define the area covered by the geometry.
code_block = CodeBlock { 0.1; }
shp_Segmentize = Custom[Shp_Segmentize](ShpGeometry=dynamo_shapely, NSegment=code_block)  # It divides a geometry into smaller segments. This process breaks down the geometry into smaller pieces for more precise analysis and calculations.
code_block_2 = CodeBlock { 0; }
shp_Voronoi = Custom[Shp_Voronoi](ShpPoint=shp_Segmentize, Density=code_block_2)  # It generates a Voronoi diagram based on the given set of points. Each Voronoi cell represents the area belonging to the nearest point.
shp_Intersection = Custom[Shp_Intersection](ShpGeometry=shp_BuildBoundary, ShpGeometry_2=shp_Voronoi)  # Rotates the common area between two geometries. The intersecting areas are taken and a new geometry is created. This process is used to determine the intersection areas.
code_block_3 = CodeBlock { 1.6; }
code_block_4 = CodeBlock { 2; }
shp_SkeletonPruning = Custom[Shp_SkeletonPruning](ShpLine=shp_Intersection, MinLength=code_block_3, MaxIteration=code_block_4)  # It uses the Topological Analysis method to clean the skeleton (centreline) of a polygon. It cleans the dead-end streets, known as ‘spurs’, which arise from Voronoi diagrams and are not connected to the main line.
shapely_dynamo = Custom[Shapely → Dynamo](ShpGeometry=shp_SkeletonPruning)  # Converts Shapely geometry to Dynamo geometry.
