# Dynamo graph Shp_Snap.dyn (Dynamo 3.4.1.7055)

select_model_elements = DSModelElementsSelection()  # 8 picked in the model
curve = DetailCurve.Curve(detailCurve=select_model_elements)
byJoinedCurves = PolyCurve.ByJoinedCurves(curves=curve)
byPatch = Surface.ByPatch(closedCurve=byJoinedCurves)
dynamo_shapely = Custom[Dynamo → Shapely](DynGeometry=byPatch)  # Converts Dynamo geometry to Shapely geometry.
code_block = CodeBlock { 4; }
translate = Geometry.Translate(geometry=byJoinedCurves, xTranslation=code_block)
byPatch_2 = Surface.ByPatch(closedCurve=translate)
dynamo_shapely_2 = Custom[Dynamo → Shapely](DynGeometry=byPatch_2)
code_block_2 = CodeBlock { 5; }
shp_Snap = Custom[Shp_Snap](ShpGeometry=dynamo_shapely, ShpGeometry_2=dynamo_shapely_2, Tolerance=code_block_2)  # Aligns the corner points of one geometry with the corners of another geometry within a specified tolerance distance. This process is used to eliminate small gaps or misalignments between geometries.
shapely_dynamo = Custom[Shapely → Dynamo](ShpGeometry=shp_Snap)  # Converts Shapely geometry to Dynamo geometry.
watch = Watch(shapely_dynamo)
color_palette = ColorPalette({R: 255, G: 0, B: 0, A: 255})
byGeometryColor = Modifiers.GeometryColor.ByGeometryColor(geometry=watch, color=color_palette)
watch_2 = Watch(byPatch)
watch_3 = Watch(shp_Snap)
