# Dynamo graph Shp_Split.dyn (Dynamo 3.4.1.7055)

select_model_elements = DSModelElementsSelection()  # 7 picked in the model
curve = DetailCurve.Curve(detailCurve=select_model_elements)
byJoinedCurves = PolyCurve.ByJoinedCurves(curves=curve)
byPatch = Surface.ByPatch(closedCurve=byJoinedCurves)
dynamo_shapely = Custom[Dynamo → Shapely](DynGeometry=byPatch)  # Converts Dynamo geometry to Shapely geometry.
select_model_elements_2 = DSModelElementsSelection()  # 8 picked in the model
curve_2 = DetailCurve.Curve(detailCurve=select_model_elements_2)
dynamo_shapely_2 = Custom[Dynamo → Shapely](DynGeometry=curve_2)
shp_Split = Custom[Shp_Split](ShpGeometry=dynamo_shapely, ShpLineString=dynamo_shapely_2)  # divides a geometry with a specified line. This operation divides a polygon or line into two separate parts relative to the given line.
shapely_dynamo = Custom[Shapely → Dynamo](ShpGeometry=shp_Split)  # Converts Shapely geometry to Dynamo geometry.
byPatch_2 = Surface.ByPatch(closedCurve=shapely_dynamo)
code_block = CodeBlock { [0..1]; }
code_block_2 = CodeBlock(x=shapely_dynamo) { 0..1..#DSCore.List.Count(x); }
color_range = ColorRange(indices=code_block, value=code_block_2)  # unwired: colors
byGeometryColor = Modifiers.GeometryColor.ByGeometryColor(geometry=byPatch_2, color=color_range)
watch = Watch(shp_Split)
watch_2 = Watch(byPatch)
watch_3 = Watch(curve_2)
