# Dynamo graph Shp_TouchebyDıstance.dyn (Dynamo 3.4.1.7055)

select_model_elements = DSModelElementsSelection()  # 7 picked in the model
curve = DetailCurve.Curve(detailCurve=select_model_elements)
byJoinedCurves = PolyCurve.ByJoinedCurves(curves=curve)
points = PolyCurve.Points(polyCurve=byJoinedCurves)
byPoints = Polygon.ByPoints(points=points)
center = Polygon.Center(polygon=byPoints)
code_block = CodeBlock { 7; }
byCenterPointRadius = Circle.ByCenterPointRadius(centerPoint=center, radius=code_block)
code_block_2 = CodeBlock { 0..1..#10; }
pointAtParameter = Curve.PointAtParameter(curve=byCenterPointRadius, param=code_block_2)
code_block_3 = CodeBlock(x=pointAtParameter) { a = DSCore.List.Count(x)-1; b = DSCore.List.Shuffle(1..2.5..#a); c = Circle.ByCenterPointRadius(x,b); }
code_block_4 = CodeBlock { 0..1..#50; }
pointAtParameter_2 = Curve.PointAtParameter(curve=code_block_3.c, param=code_block_4@L2, lacing=Longest)
byPoints_2 = Polygon.ByPoints(points=pointAtParameter_2)
dynamo_shapely = Custom[Dynamo → Shapely](DynGeometry=byPoints_2)  # Converts Dynamo geometry to Shapely geometry.
code_block_5 = CodeBlock { 3; }
byPatch = Surface.ByPatch(closedCurve=byJoinedCurves)
dynamo_shapely_2 = Custom[Dynamo → Shapely](DynGeometry=byPatch)
shp_TouchesByDistance = Custom[Shp_TouchesByDistance](Distance=code_block_5, ShpGeometry=dynamo_shapely_2, ShpGeometry_2=dynamo_shapely)  # It checks the contact status based on the distance between two geometries. This examines whether the geometries are in contact with each other, but only up to a certain distance.
code_block_6 = CodeBlock(List=dynamo_shapely, Boolean=shp_TouchesByDistance) { DSCore.List.GroupByKey(_List,Boolean)["groups"]; }
code_block_7 = CodeBlock(NotTouches=code_block_6, Touches=code_block_6) { NotTouches[0]; Touches[1]; }
shapely_dynamo = Custom[Shapely → Dynamo](ShpGeometry=code_block_7.out1)  # Converts Shapely geometry to Dynamo geometry.
color_palette = ColorPalette({R: 255, G: 0, B: 0, A: 255})
byGeometryColor = Modifiers.GeometryColor.ByGeometryColor(geometry=shapely_dynamo, color=color_palette)
watch = Watch(byPatch)
watch_2 = Watch(byPoints_2)
shapely_dynamo_2 = Custom[Shapely → Dynamo](ShpGeometry=code_block_7.out0)
byPatch_2 = Surface.ByPatch(closedCurve=shapely_dynamo_2)
watch_3 = Watch(shapely_dynamo)
shp_Distance = Custom[Shp_Distance](ShpGeometry=dynamo_shapely_2, ShpGeometry_2=dynamo_shapely)  # Calculates the shortest distance between two geometries.
watch_4 = Watch(shp_Distance)
watch_5 = Watch(shp_TouchesByDistance)
