# Dynamo graph Shp_Touches.dyn (Dynamo 3.4.1.7055)

code_block = CodeBlock { x = 10; 10; }
byWidthLength = Rectangle.ByWidthLength(width=code_block.x, length=code_block.x)
byPatch = Surface.ByPatch(closedCurve=byWidthLength)
dynamo_shapely = Custom[Dynamo → Shapely](DynGeometry=byPatch)  # Converts Dynamo geometry to Shapely geometry.
translate = Geometry.Translate(geometry=byWidthLength, xTranslation=code_block.out1)
byPatch_2 = Surface.ByPatch(closedCurve=translate)
dynamo_shapely_2 = Custom[Dynamo → Shapely](DynGeometry=byPatch_2)
shp_Touches = Custom[Shp_Touches](ShpGeometry=dynamo_shapely, ShpGeometry_2=dynamo_shapely_2)  # It checks whether there is any boundary contact between two geometries. This determines whether the edges of the geometries touch each other.
watch = Watch(shp_Touches)
