# Dynamo graph Shp_Triangulate.dyn (Dynamo 3.4.1.7055)

select_model_element = DSModelElementSelection()  # 1 picked in the model
geometry = Element.Geometry(element=select_model_element)
position = ModelText.Position(modelText=select_model_element)
ZAxis = Vector.ZAxis()
byOriginNormal = Plane.ByOriginNormal(origin=position, normal=ZAxis)
intersect = Geometry.Intersect(geometry=geometry, other=byOriginNormal)
dynamo_shapely = Custom[Dynamo → Shapely](DynGeometry=intersect)  # Converts Dynamo geometry to Shapely geometry.
code_block = CodeBlock { 0.1; }
shp_Segmentize = Custom[Shp_Segmentize](ShpGeometry=dynamo_shapely, NSegment=code_block)  # It divides a geometry into smaller segments. This process breaks down the geometry into smaller pieces for more precise analysis and calculations.
code_block_2 = CodeBlock { 0; }
shp_Voronoi = Custom[Shp_Voronoi](ShpPoint=shp_Segmentize, Density=code_block_2)  # It generates a Voronoi diagram based on the given set of points. Each Voronoi cell represents the area belonging to the nearest point.
shp_Intersection = Custom[Shp_Intersection](ShpGeometry=dynamo_shapely, ShpGeometry_2=shp_Voronoi)  # Rotates the common area between two geometries. The intersecting areas are taken and a new geometry is created. This process is used to determine the intersection areas.
shp_Triangulate = Custom[Shp_Triangulate](ShpGeometry=shp_Intersection, ShpClipGeometry=dynamo_shapely)  # It divides a polygon or a set of points into non-overlapping triangles. This process allows geometry to be broken down into smaller and simpler parts and is widely used in computational geometry.
shapely_dynamo = Custom[Shapely → Dynamo](ShpGeometry=shp_Triangulate)  # Converts Shapely geometry to Dynamo geometry.
code_block_3 = CodeBlock { None; }  # unwired: None
watch = Watch(dynamo_shapely)
watch_2 = Watch(shp_Triangulate)
