# Dynamo graph Shp_Union.dyn (Dynamo 3.4.1.7055)

select_model_elements = DSModelElementsSelection()  # 6 picked in the model
curve = DetailCurve.Curve(detailCurve=select_model_elements)
byJoinedCurves = PolyCurve.ByJoinedCurves(curves=curve)
byPatch = Surface.ByPatch(closedCurve=byJoinedCurves)
dynamo_shapely = Custom[Dynamo → Shapely](DynGeometry=byPatch)  # Converts Dynamo geometry to Shapely geometry.
select_model_elements_2 = DSModelElementsSelection()  # 4 picked in the model
curve_2 = DetailCurve.Curve(detailCurve=select_model_elements_2)
byJoinedCurves_2 = PolyCurve.ByJoinedCurves(curves=curve_2)
byPatch_2 = Surface.ByPatch(closedCurve=byJoinedCurves_2)
dynamo_shapely_2 = Custom[Dynamo → Shapely](DynGeometry=byPatch_2)
list_create = List.Create(item0=dynamo_shapely, item1=dynamo_shapely_2)
shp_Union = Custom[Shp_Union](ShpGeometry=list_create)  # It divides a polygon or a set of points into non-overlapping triangles. This process allows geometry to be broken down into smaller and simpler parts and is widely used in computational geometry.
shapely_dynamo = Custom[Shapely → Dynamo](ShpGeometry=shp_Union)  # Converts Shapely geometry to Dynamo geometry.
watch = Watch(shapely_dynamo)
byPatch_3 = Surface.ByPatch(closedCurve=watch)
code_block = CodeBlock(x=byPatch_3) { 0..1..#DSCore.List.Count(x); [0..1]; }
color_range = ColorRange(indices=code_block.out1, value=code_block.out0)  # unwired: colors
byGeometryColor = Modifiers.GeometryColor.ByGeometryColor(geometry=byPatch_3, color=color_range)
list_create_2 = List.Create(item0=byPatch, item1=byPatch_2)
code_block_2 = CodeBlock { -3.5; }
translate = Geometry.Translate(geometry=list_create_2, xTranslation=code_block_2)
translate_2 = Geometry.Translate(geometry=byJoinedCurves_2, xTranslation=code_block_2)
watch_2 = Watch(list_create)
watch_3 = Watch(byPatch)
watch_4 = Watch(shp_Union)
